# Dynamo graph Add or Remove Revisions.dyn (Dynamo 1.3.4.6666)

# group: Logo
file_path = Filename("..\..\Imagens\Joao-2019\20190810\102APPLE\IMG_2333.PNG")

# group: Get Revsions
boolean = BoolSelector(true)
get_all_revisions = Custom[Get All Revisions](RunIt=boolean)  # This node will return all Revisions currently defined in the mode.

revision_properties = Custom[Revision Properties](Revision=get_all_revisions)  # This node will return some most common Revision properties like Description or Issue Date.
sortIndexByValue = SortIndexByValue(revision_properties.Sequence)
getItemAtIndex = List.GetItemAtIndex(list=get_all_revisions, index=sortIndexByValue)

# group: UI Revisions
string = StringInput("Revision to Apply")
name = Element.Name(get_all_revisions)
code_block = CodeBlock { 0; }

getItemAtIndex_2 = List.GetItemAtIndex(list=name, index=sortIndexByValue)

# group (continued): UI Revisions
ui_dropdown_data = Custom[UI.DropDown Data](InputName=string, Keys=getItemAtIndex_2, Values=getItemAtIndex, DefaultValueIndex=code_block)  # Create data for DropDown input in UI.MultiInputForm ++ . Check out www.data-shapes.net for more infos.

# group: Sheet and Name
string_2 = StringInput("-")
join = String.Join(string_2)  # unwired: arg1, arg2
categories = Categories("Sheets")
all_elements_of_category = ElementsOfCategory(categories)
sheetNumber = Sheet.SheetNumber(all_elements_of_category)
sheetName = Sheet.SheetName(all_elements_of_category)
combine = List.Combine(join, sheetNumber, sheetName)

boolean_2 = BoolSelector(true)

# group: UI Sheets
code_block_2 = CodeBlock { 300; }
boolean_3 = BoolSelector(false)
code_block_3 = CodeBlock { 0; }
ui_listview_data = Custom[UI.Listview Data](Keys=combine, Values=all_elements_of_category, Height_optionnal=code_block_2, HighlightInView_optionnal=boolean_3, DisplayModeOnly_optionnal=boolean_3, ShowElementCount_optionnal=boolean_3, DefaultValueIndices_optionnal=code_block_3, SortItems=boolean_2)  # Create data for ListView input in UI.MultiInputForm ++ . Check out www.data-shapes.net for more infos.

# group: UI Add or Remove
code_block_4 = CodeBlock { "Add or Remove"; {"Add","Remove"}; {true, false}; 0; }
ui_radiobuttons_data = Custom[UI.RadioButtons Data](InputName=code_block_4.out0, Keys=code_block_4.out1, Values=code_block_4.out2, DefaultValueIndex=code_block_4.out3)  # Create radio buttons input for UI.MultipleInputForm ++ .

# group: UI Build
string_3 = StringInput("Apply Revisions to Sheets")
string_4 = StringInput("Run Script")
create = List.Create(ui_dropdown_data, ui_listview_data, ui_radiobuttons_data)
boolean_4 = BoolSelector(true)
string_5 = StringInput("Cancel Script")
code_block_5 = CodeBlock { 900; 500; }
ui_multipleinputform = Custom[UI.MultipleInputForm ++](Description_optional=string_3, Logo_optional=file_path, ButtonText_optional=string_4, Inputs=create, Toggle=boolean_4, LinkToHelp_optional=file_path, CancelButtonText_optional=string_5, MaxHeight_optional=code_block_5.out0, Width_optional=code_block_5.out1)  # Create a form with multiple inputs. see www.data-shapes.net for tutorials and infos!

# group: Add or Remove
code_block_6 = CodeBlock { 0; 1; 2; }
getItemAtIndex_3 = List.GetItemAtIndex(list=ui_multipleinputform.User_Inputs, index=code_block_6.out1)
getItemAtIndex_4 = List.GetItemAtIndex(list=ui_multipleinputform.User_Inputs, index=code_block_6.out2)
getItemAtIndex_5 = List.GetItemAtIndex(list=ui_multipleinputform.User_Inputs, index=code_block_6.out0)
boolean_5 = BoolSelector(true)
add_revisions_to_sheet = Custom[Add Revisions to Sheet](Revision=getItemAtIndex_5, RunIt=boolean_5)  # This node will add specified revisions to a sheet.; unwired: Sheet
remove_revision_from_sheet = Custom[Remove Revision from Sheet](Revision=getItemAtIndex_5, RunIt=boolean_5)  # This node will remove specified Revisions from a sheet.; unwired: Sheet
if_ = If(test=getItemAtIndex_4, true=add_revisions_to_sheet, false=remove_revision_from_sheet)
map = List.Map(list=getItemAtIndex_3, f_x=if_)

watch = Watch(getItemAtIndex_3)
watch_2 = Watch(ui_multipleinputform.User_Inputs)
