# Dynamo graph Export PDFv.0.dyn (Dynamo 1.3.4.6666)

view_sets = ViewSetUi("Tender")
get_views_from_view_set = Custom[Get Views from View Set](ViewSet=view_sets)  # This node will take a name of a view set and return views/sheet elements contained in it.
watch = Watch(get_views_from_view_set)
print_range = PrintRangeUi("Select")
boolean = BoolSelector(true)
code_block = CodeBlock { "Soda PDF Desktop 11"; }
print_settings = PrintSettingUi("HJL_A1_PDF - Landscape")
boolean_2 = BoolSelector(true)
print_pdf = Custom[Print PDF](Views=watch, PrintRange=print_range, CombinedFile=boolean, PrinterName=code_block, PrintSettings=print_settings, RunIt=boolean_2)  # This node will allow you to initiate a printing routine in revit from a set of views/sheets, printer name, print settings and print range.; unwired: FilePath
watch_2 = Watch(print_pdf)
directory_path = Directory("C:\Users\jpmuc\OneDrive\Área de Trabalho\WIP")
fromPath = DirectoryObject(directory_path)  # "Directory.FromPath"
code_block_2 = CodeBlock { "*.rvt"; }
contents = Directory.Contents(fromPath, code_block_2)
watch_3 = Watch(contents)
