# Dynamo graph Export PDFv.1.dyn (Dynamo 1.3.4.6666)

# group: Get Revsions
boolean = BoolSelector(true)
get_all_revisions = Custom[Get All Revisions](RunIt=boolean)  # This node will return all Revisions currently defined in the mode.

revision_properties = Custom[Revision Properties](Revision=get_all_revisions)  # This node will return some most common Revision properties like Description or Issue Date.
sortIndexByValue = SortIndexByValue(revision_properties.Sequence)
getItemAtIndex = List.GetItemAtIndex(list=get_all_revisions, index=sortIndexByValue)

# group: UI Revisions
string = StringInput("Paper Size")
name = Element.Name(get_all_revisions)
code_block = CodeBlock { 0; }

getItemAtIndex_2 = List.GetItemAtIndex(list=name, index=sortIndexByValue)

# group (continued): UI Revisions
ui_dropdown_data = Custom[UI.DropDown Data](InputName=string, Keys=getItemAtIndex_2, Values=getItemAtIndex, DefaultValueIndex=code_block)  # Create data for DropDown input in UI.MultiInputForm ++ . Check out www.data-shapes.net for more infos.

print_to_pdf = MandrillPrintNodeModel()  # unwired: arg0, arg1, arg2

# group: Logo
file_path = Filename("..\..\Imagens\Joao-2019\20190810\102APPLE\IMG_2333.PNG")

# group: Sheet and Name
string_2 = StringInput("-")
join = String.Join(string_2)  # unwired: arg1, arg2
categories = Categories("Sheets")
all_elements_of_category = ElementsOfCategory(categories)
sheetNumber = Sheet.SheetNumber(all_elements_of_category)
sheetName = Sheet.SheetName(all_elements_of_category)
combine = List.Combine(join, sheetNumber, sheetName)

boolean_2 = BoolSelector(true)

# group: UI Sheets
code_block_2 = CodeBlock { 300; }
boolean_3 = BoolSelector(false)
code_block_3 = CodeBlock { 0; }
ui_listview_data = Custom[UI.Listview Data](Keys=combine, Values=all_elements_of_category, Height_optionnal=code_block_2, HighlightInView_optionnal=boolean_3, DisplayModeOnly_optionnal=boolean_3, ShowElementCount_optionnal=boolean_3, DefaultValueIndices_optionnal=code_block_3, SortItems=boolean_2)  # Create data for ListView input in UI.MultiInputForm ++ . Check out www.data-shapes.net for more infos.

# group: UI Build
string_3 = StringInput("Export PDFs")
string_4 = StringInput("Run Script")
create = List.Create(ui_listview_data)
boolean_4 = BoolSelector(true)
string_5 = StringInput("Cancel Script")
code_block_4 = CodeBlock { 900; 500; }
ui_multipleinputform = Custom[UI.MultipleInputForm ++](Description_optional=string_3, Logo_optional=file_path, ButtonText_optional=string_4, Inputs=create, Toggle=boolean_4, LinkToHelp_optional=file_path, CancelButtonText_optional=string_5, MaxHeight_optional=code_block_4.out0, Width_optional=code_block_4.out1)  # Create a form with multiple inputs. see www.data-shapes.net for tutorials and infos!

code_block_5 = CodeBlock(a=ui_multipleinputform.User_Inputs) { a[0]; }
print_range = PrintRangeUi("Select")
print_settings = PrintSettingUi("A1_PDF")
print_pdf = Custom[Print PDF](Views=code_block_5, PrintRange=print_range, PrintSettings=print_settings)  # This node will allow you to initiate a printing routine in revit from a set of views/sheets, printer name, print settings and print range.; unwired: PrinterName, FilePath
