# Dynamo graph Export PDFv.2.dyn (Dynamo 1.3.4.6666)

print_range = PrintRangeUi("Select")
boolean = BoolSelector(false)

# group: Logo
file_path = Filename("..\..\Imagens\Joao-2019\20190810\102APPLE\IMG_2333.PNG")

string = StringInput("Printer Name")
local_printers_names = Custom[Local Printers Names]()  # This node will query all locally installed printers and return their names.
code_block = CodeBlock { 3; }
ui_dropdown_data = Custom[UI.DropDown Data](InputName=string, Keys=local_printers_names, Values=local_printers_names, DefaultValueIndex=code_block)  # Create data for DropDown input in UI.MultiInputForm ++ . Check out www.data-shapes.net for more infos.
string_2 = StringInput("Paper Size")
print_settings = PrintSettingUi("HJL_A0_PDF - Landscape")
print_settings_2 = PrintSettingUi("HJL_A0_PDF - Portrait")
print_settings_3 = PrintSettingUi("HJL_A1_PDF - Landscape")
print_settings_4 = PrintSettingUi("HJL_A1_PDF - Portrait")
print_settings_5 = PrintSettingUi("HJL_A2_PDF - Landscape")
print_settings_6 = PrintSettingUi("HJL_A2_PDF - Portrait")
print_settings_7 = PrintSettingUi("HJL_A3_PDF - Landscape")
print_settings_8 = PrintSettingUi("HJL_A3_PDF - Portrait")
print_settings_9 = PrintSettingUi("HJL_A4_PDF - Landscape")
print_settings_10 = PrintSettingUi("HJL_A4_PDF - Portrait")
create = List.Create(print_settings, print_settings_2, print_settings_3, print_settings_4, print_settings_5, print_settings_6, print_settings_7, print_settings_8, print_settings_9, print_settings_10)
watch = Watch(create)
name = Element.Name(watch)
watch_2 = Watch(name)
code_block_2 = CodeBlock { 0; }
ui_dropdown_data_2 = Custom[UI.DropDown Data](InputName=string_2, Keys=watch_2, Values=watch, DefaultValueIndex=code_block_2)

# group: Sheet and Name
string_3 = StringInput("-")
join = String.Join(string_3)  # unwired: arg1, arg2
categories = Categories("Sheets")
all_elements_of_category = ElementsOfCategory(categories)
sheetNumber = Sheet.SheetNumber(all_elements_of_category)
sheetName = Sheet.SheetName(all_elements_of_category)
combine = List.Combine(join, sheetNumber, sheetName)

# group: UI Sheets
code_block_3 = CodeBlock { 300; }
boolean_2 = BoolSelector(false)
code_block_4 = CodeBlock { 0; }
boolean_3 = BoolSelector(true)
ui_listview_data = Custom[UI.Listview Data](Keys=combine, Values=all_elements_of_category, Height_optionnal=code_block_3, HighlightInView_optionnal=boolean_2, DisplayModeOnly_optionnal=boolean_2, ShowElementCount_optionnal=boolean_2, DefaultValueIndices_optionnal=code_block_4, SortItems=boolean_3)  # Create data for ListView input in UI.MultiInputForm ++ . Check out www.data-shapes.net for more infos.

code_block_5 = CodeBlock { "Directory Path"; }
ui_directorypath_data = Custom[UI.DirectoryPath Data](ButtonText=code_block_5)  # Creates a DirectoryPath input for UI.MultipleInputForm ++ . Check out www.data-shapes.net for more infos!

# group: UI Build
string_4 = StringInput("Export PDFs")
string_5 = StringInput("Run Script")
create_2 = List.Create(ui_dropdown_data, ui_dropdown_data_2, ui_listview_data, ui_directorypath_data)
boolean_4 = BoolSelector(true)
string_6 = StringInput("Cancel Script")
code_block_6 = CodeBlock { 900; 500; }
ui_multipleinputform = Custom[UI.MultipleInputForm ++](Description_optional=string_4, Logo_optional=file_path, ButtonText_optional=string_5, Inputs=create_2, Toggle=boolean_4, LinkToHelp_optional=file_path, CancelButtonText_optional=string_6, MaxHeight_optional=code_block_6.out0, Width_optional=code_block_6.out1)  # Create a form with multiple inputs. see www.data-shapes.net for tutorials and infos!

code_block_7 = CodeBlock(a=ui_multipleinputform.User_Inputs) { a[0]; }
code_block_8 = CodeBlock(a=ui_multipleinputform.User_Inputs) { a[1]; }
boolean_5 = BoolSelector(true)
print_pdf = Custom[Print PDF](PrintRange=print_range, CombinedFile=boolean, PrinterName=code_block_7, PrintSettings=code_block_8, RunIt=boolean_5)  # This node will allow you to initiate a printing routine in revit from a set of views/sheets, printer name, print settings and print range.; unwired: Views, FilePath
string_7 = StringInput("-")
join_2 = String.Join(string_7)  # unwired: arg1, arg2
categories_2 = Categories("ProjectInformation")  # frozen
all_elements_of_category_2 = ElementsOfCategory(categories_2)
code_block_9 = CodeBlock { "00_ProjectDesignator_HJL"; "00_OriginatorDesignator_HJL"; "00_DisciplineDesignator_HJL"; }  # frozen
getParameterValueByName = Element.GetParameterValueByName(element=all_elements_of_category_2, parameterName=code_block_9.out0)
getParameterValueByName_2 = Element.GetParameterValueByName(element=all_elements_of_category_2, parameterName=code_block_9.out1)
combine_2 = List.Combine(join_2, getParameterValueByName, getParameterValueByName_2)
watch_3 = Watch(combine_2)
code_block_10 = CodeBlock { "-"; }
add = watch_3 + code_block_10
string_8 = StringInput("-")
join_3 = String.Join(string_8)  # unwired: arg1, arg2, arg3
code_block_11 = CodeBlock { "00_Zone_HJL"; "24_LevelDesignator_HJL"; "24_TypeDesignator_HJL"; }  # frozen
getParameterValueByName_3 = Element.GetParameterValueByName(parameterName=code_block_11.out0)  # unwired: element
getParameterValueByName_4 = Element.GetParameterValueByName(parameterName=code_block_11.out1)  # unwired: element
getParameterValueByName_5 = Element.GetParameterValueByName(parameterName=code_block_11.out2)  # unwired: element
combine_3 = List.Combine(join_3, getParameterValueByName_3, getParameterValueByName_4, getParameterValueByName_5)
code_block_12 = CodeBlock { "-"; }
getParameterValueByName_6 = Element.GetParameterValueByName(element=all_elements_of_category_2, parameterName=code_block_9.out2)
add_2 = code_block_12 + getParameterValueByName_6
add_3 = combine_3 + add_2@L1
flatten = Flatten(add_3)
code_block_13 = CodeBlock { "-"; }
string_9 = StringInput("-")
join_4 = String.Join(string_9)  # frozen; unwired: arg1, arg2
sheetNumber_2 = Sheet.SheetNumber()  # unwired: arg0
sheetName_2 = Sheet.SheetName()  # unwired: arg0
combine_4 = List.Combine(join_4, sheetNumber_2, sheetName_2)
add_4 = code_block_13 + combine_4
add_5 = flatten + add_4
add_6 = add@L1 + add_5
flatten_2 = Flatten(add_6)
string_from_object = FromObject(flatten_2)
watch_4 = Watch(local_printers_names)
code_block_14 = CodeBlock(a=ui_multipleinputform.User_Inputs) { a[3]; }
filenameToFilePaths = Custom[FilenameToFilePaths](DirectoryPath=code_block_14)  # Add directory and .pdf extension to filenames.; unwired: Filenames
code_block_15 = CodeBlock(a=ui_multipleinputform.User_Inputs) { a[2]; }
print_pdf_multiple_formats = Custom[Print PDF (multiple formats)](FilePaths=filenameToFilePaths, Views=code_block_15)  # This node will allow you to initiate a printing routine from a set of views/sheets, filename, printer name, print settings with many formats and print range. Based on an archilab node.; unwired: PrintSetting, PrinterName, PrintRange
