# Dynamo graph Issue Sheetv0.dyn (Dynamo 1.3.4.6666)

file_path = Filename(".\MIDP.xlsx")
code_block = CodeBlock { "Sheet1"; 2; 3; }
categories = Categories("Sheets")
all_elements_of_category = ElementsOfCategory(categories)
get_all_revisions = Custom[Get All Revisions](RunIt=all_elements_of_category)  # This node will return all Revisions currently defined in the mode.
count = List.Count(get_all_revisions)
code_block_2 = CodeBlock(count=count) { 0..#count..1; }
getItemAtIndex = List.GetItemAtIndex(list=get_all_revisions, index=code_block_2)
revision_properties = Custom[Revision Properties](Revision=getItemAtIndex)  # This node will return some most common Revision properties like Description or Issue Date.
code_block_3 = CodeBlock { 0; }
getItemAtIndex_2 = List.GetItemAtIndex(list=revision_properties.Date, index=code_block_3)
create = List.Create(getItemAtIndex_2)
boolean = BoolSelector(true)
writeToFile = Excel.WriteToFile(filePath=file_path, sheetName=code_block.out0, startRow=code_block.out1, startCol=code_block.out2, data=create, overWrite=boolean)
revisions = archilab.Revit.Views.Sheets.Revisions(all_elements_of_category)
revisionDate = Revision.RevisionDate(revisions)
watch = Watch(revisionDate)
code_block_4 = CodeBlock { 4; 0; }
sheetName = Sheet.SheetName(all_elements_of_category)
watch_2 = Watch(sheetName)
writeToFile_2 = Excel.WriteToFile(filePath=file_path, sheetName=code_block.out0, startRow=code_block_4.out0, startCol=code_block_4.out1, data=watch_2, overWrite=boolean)
getRevisionNumberOnSheet = archilab.Revit.Views.Sheets.GetRevisionNumberOnSheet(all_elements_of_category, getItemAtIndex)
create_2 = List.Create(getRevisionNumberOnSheet)
watch_3 = Watch(create_2)
writeToFile_3 = Excel.WriteToFile(filePath=file_path, sheetName=code_block.out0, startRow=code_block_4.out0, startCol=code_block.out2, data=watch_3, overWrite=boolean)
