# Dynamo graph Issue Sheetv1.dyn (Dynamo 1.3.4.6666)

create = List.Create()  # unwired: arg0, arg1, arg2, arg3, arg4, arg5
create_2 = List.Create()  # unwired: arg0, arg1, arg2, arg3, arg4, arg5
create_3 = List.Create()  # unwired: arg0, arg1, arg2
categories = Categories("Sheets")
all_elements_of_category = ElementsOfCategory(categories)
code_block = CodeBlock { "24_DrawingSeriesNo"; "Sheet Number"; }
getParameterValueByName = Element.GetParameterValueByName(element=all_elements_of_category, parameterName=code_block.out0)
categories_2 = Categories("TitleBlocks")
all_elements_of_category_2 = ElementsOfCategory(categories_2)
getParameterValueByName_2 = Element.GetParameterValueByName(element=all_elements_of_category, parameterName=code_block.out1)
getParameterValueByName_3 = Element.GetParameterValueByName(element=all_elements_of_category_2, parameterName=code_block.out1)
indexOf = IndexOf(getParameterValueByName_3)  # unwired: arg1
map = List.Map(list=getParameterValueByName_2, f_x=indexOf)
getItemAtIndex = List.GetItemAtIndex(list=all_elements_of_category_2, index=map)
combine = List.Combine(create_3, all_elements_of_category, getParameterValueByName, getItemAtIndex)
code_block_2 = CodeBlock { 0; 1; 2; }
getItemAtIndex_2 = List.GetItemAtIndex(list=combine@L2, index=code_block_2.out0)
sheetNumber = Sheet.SheetNumber(getItemAtIndex_2)
sheetName = Sheet.SheetName(getItemAtIndex_2)
scale = Custom[Sheet.Scale](sheet=getItemAtIndex_2)  # Returns the scale of a given sheet
getItemAtIndex_3 = List.GetItemAtIndex(list=combine@L2, index=code_block_2.out1)
getItemAtIndex_4 = List.GetItemAtIndex(list=combine@L2, index=code_block_2.out2)
string_from_object = FromObject(getItemAtIndex_4)
code_block_3 = CodeBlock { "_"; }
split = String.Split(string_from_object, code_block_3)
code_block_4 = CodeBlock { 1; 2; }
getItemAtIndex_5 = List.GetItemAtIndex(list=split@L2, index=code_block_4.out0)
code_block_5 = CodeBlock { 2; " "; }
insert = String.Insert(str=getItemAtIndex_5, index=code_block_5.out0, toInsert=code_block_5.out1)
getItemAtIndex_6 = List.GetItemAtIndex(list=split@L2, index=code_block_4.out1)
add = insert + getItemAtIndex_6
combine_2 = List.Combine(create_2, getItemAtIndex_2, sheetNumber, sheetName, scale, getItemAtIndex_3, add)
code_block_6 = CodeBlock { 1; }
getItemAtIndex_7 = List.GetItemAtIndex(index=code_block_6)  # unwired: list
sortByFunction = SortByFunction(combine_2, getItemAtIndex_7)
code_block_7 = CodeBlock { 0; 1; 2; 3; 5; 4; }
getItemAtIndex_8 = List.GetItemAtIndex(list=sortByFunction@L2, index=code_block_7.out0)
getItemAtIndex_9 = List.GetItemAtIndex(list=sortByFunction@L2, index=code_block_7.out1)
getItemAtIndex_10 = List.GetItemAtIndex(list=sortByFunction@L2, index=code_block_7.out2)
getItemAtIndex_11 = List.GetItemAtIndex(list=sortByFunction@L2, index=code_block_7.out3)
getItemAtIndex_12 = List.GetItemAtIndex(list=sortByFunction@L2, index=code_block_7.out4)
getItemAtIndex_13 = List.GetItemAtIndex(list=sortByFunction@L2, index=code_block_7.out5)
combine_3 = List.Combine(create, getItemAtIndex_8, getItemAtIndex_9, getItemAtIndex_10, getItemAtIndex_11, getItemAtIndex_12, getItemAtIndex_13)
sortByKey = List.SortByKey(list=combine_3, keys=getItemAtIndex_13)
watch = Watch(sortByKey.sorted_list)
code_block_8 = CodeBlock { 0; 1; 2; 3; 4; 5; }
getItemAtIndex_14 = List.GetItemAtIndex(list=watch@L2, index=code_block_8.out0)
get_all_revisions = Custom[Get All Revisions](RunIt=getItemAtIndex_14)  # This node will return all Revisions currently defined in the mode.
getRevisionNumberOnSheet = archilab.Revit.Views.Sheets.GetRevisionNumberOnSheet(getItemAtIndex_14, get_all_revisions)
name = Element.Name(get_all_revisions)
watch_2 = Watch(name)
file_path = Filename(".\MIDP.xlsx")
code_block_9 = CodeBlock { "Sheet1"; 5; 0; }
addItemToFront = List.AddItemToFront()  # unwired: item, list
getItemAtIndex_15 = List.GetItemAtIndex(list=watch@L2, index=code_block_8.out1)
getItemAtIndex_16 = List.GetItemAtIndex(list=watch@L2, index=code_block_8.out5)
groupByKey = List.GroupByKey(list=getItemAtIndex_15, keys=getItemAtIndex_16)
combine_4 = List.Combine(addItemToFront, groupByKey.unique_keys, groupByKey.groups)
flatten = Flatten(combine_4)
empty = List.Empty()
getItemAtIndex_17 = List.GetItemAtIndex(list=watch@L2, index=code_block_8.out2)
groupByKey_2 = List.GroupByKey(list=getItemAtIndex_17, keys=getItemAtIndex_16)
combine_5 = List.Combine(addItemToFront, empty, groupByKey_2.groups)
flatten_2 = Flatten(combine_5)
getItemAtIndex_18 = List.GetItemAtIndex(list=watch@L2, index=code_block_8.out3)
groupByKey_3 = List.GroupByKey(list=getItemAtIndex_18, keys=getItemAtIndex_16)
combine_6 = List.Combine(addItemToFront, empty, groupByKey_3.groups)
flatten_3 = Flatten(combine_6)
getItemAtIndex_19 = List.GetItemAtIndex(list=watch@L2, index=code_block_8.out4)
groupByKey_4 = List.GroupByKey(list=getItemAtIndex_19, keys=getItemAtIndex_16)
combine_7 = List.Combine(addItemToFront, empty, groupByKey_4.groups)
flatten_4 = Flatten(combine_7)
create_4 = List.Create(flatten, flatten_2, flatten_3, flatten_4)
transpose = List.Transpose(create_4)
boolean = BoolSelector(true)
writeToFile = Excel.WriteToFile(filePath=file_path, sheetName=code_block_9.out0, startRow=code_block_9.out1, startCol=code_block_9.out2, data=transpose, overWrite=boolean)  # frozen
code_block_10 = CodeBlock { "Revision No."; }
revision_properties = Custom[Revision Properties](Revision=get_all_revisions)  # This node will return some most common Revision properties like Description or Issue Date.
firstItem = List.FirstItem(revision_properties.Sequence)
lastItem = List.LastItem(firstItem)
add_2 = code_block_10 + lastItem
watch_3 = Watch(add_2)
watch_4 = Watch(combine_2)
watch_5 = Watch(create_4)
firstItem_2 = List.FirstItem(revision_properties.Date)
name_2 = Element.Name(get_all_revisions)
revisions = Archilab.Grimshaw.Views.Sheet.Revisions(getItemAtIndex_14)
watch_6 = Watch(revisions)
name_3 = DynamoUnits.Location.Name()  # unwired: arg0
