# Dynamo graph Issue Sheetv10.dyn (Dynamo 1.3.4.6666)

# group: File Path + Trasaction Start
file_path = Filename("..\..\Block 1_Records\Construction\Schedules\CSD2-HJL-B1-XX-SH-A-0001-Drawing_Register_Construction.xlsx")
start = Revit.Transaction.Transaction.Start(file_path)

# group: Get a Mapped list of Sheets and Title Blocks
categories = Categories("Sheets")
all_elements_of_category = ElementsOfCategory(categories)
code_block = CodeBlock { "24_DrawingSeriesNo_HJL"; "Sheet Number"; }
getParameterValueByName = Element.GetParameterValueByName(element=all_elements_of_category, parameterName=code_block.out0)
categories_2 = Categories("TitleBlocks")
all_elements_of_category_2 = ElementsOfCategory(categories_2)
getParameterValueByName_2 = Element.GetParameterValueByName(element=all_elements_of_category, parameterName=code_block.out1)
getParameterValueByName_3 = Element.GetParameterValueByName(element=all_elements_of_category_2, parameterName=code_block.out1)
indexOf = IndexOf(getParameterValueByName_3)  # unwired: arg1
map = List.Map(list=getParameterValueByName_2, f_x=indexOf)
getItemAtIndex = List.GetItemAtIndex(list=all_elements_of_category_2, index=map)

# group: Filtering by parameter Value
code_block_2 = CodeBlock { "Appears In Sheet List"; }
getParameterValueByName_4 = Element.GetParameterValueByName(element=all_elements_of_category, parameterName=code_block_2)
code_block_3 = CodeBlock { 1; }
eq = getParameterValueByName_4 == code_block_3
boolean = BoolSelector(true)
allIndicesOf = List.AllIndicesOf(list=eq, item=boolean)

# group: Combine Sheets + Drawing Series No. + Titleblock
create = List.Create()  # unwired: arg0, arg1, arg2
getItemAtIndex_2 = List.GetItemAtIndex(list=all_elements_of_category, index=allIndicesOf)
getItemAtIndex_3 = List.GetItemAtIndex(list=getParameterValueByName, index=allIndicesOf)
getItemAtIndex_4 = List.GetItemAtIndex(list=getItemAtIndex, index=allIndicesOf)
combine = List.Combine(create, getItemAtIndex_2, getItemAtIndex_3, getItemAtIndex_4)

# group: Get Sheet Element, Sheet Number, Shee Name, Sheet Scale, Drawings Series No.
code_block_4 = CodeBlock { 0; 1; }
getItemAtIndex_5 = List.GetItemAtIndex(list=combine@L2, index=code_block_4.out0)
sheetNumber = Sheet.SheetNumber(getItemAtIndex_5)
sheetName = Sheet.SheetName(getItemAtIndex_5)
scale = Custom[Sheet.Scale](sheet=getItemAtIndex_5)  # Returns the scale of a given sheet
getItemAtIndex_6 = List.GetItemAtIndex(list=combine@L2, index=code_block_4.out1)

# group: Final Titleblock Name
code_block_5 = CodeBlock { 2; }
getItemAtIndex_7 = List.GetItemAtIndex(list=combine@L2, index=code_block_5)
string_from_object = FromObject(getItemAtIndex_7)
code_block_6 = CodeBlock { "_"; }
split = String.Split(string_from_object, code_block_6)
code_block_7 = CodeBlock { 3; 2; }
getItemAtIndex_8 = List.GetItemAtIndex(list=split@L2, index=code_block_7.out1)
code_block_8 = CodeBlock { 2; " "; }
insert = String.Insert(str=getItemAtIndex_8, index=code_block_8.out0, toInsert=code_block_8.out1)
getItemAtIndex_9 = List.GetItemAtIndex(list=split@L2, index=code_block_7.out0)
add = insert + getItemAtIndex_9

# group: Combine Sheet Element, Number, Name, Scale, Final Titleblock Name
create_2 = List.Create()  # unwired: arg0, arg1, arg2, arg3, arg4, arg5
combine_2 = List.Combine(create_2, getItemAtIndex_5, sheetNumber, sheetName, scale, getItemAtIndex_6, add)

# group: Sorting by Sheet Number and Drawing Series No.
create_3 = List.Create()  # unwired: arg0, arg1, arg2, arg3, arg4, arg5
code_block_9 = CodeBlock { 1; }
getItemAtIndex_10 = List.GetItemAtIndex(index=code_block_9)  # unwired: list
sortByFunction = SortByFunction(combine_2, getItemAtIndex_10)
code_block_10 = CodeBlock { 0; 1; 2; 3; 5; 4; }
getItemAtIndex_11 = List.GetItemAtIndex(list=sortByFunction@L2, index=code_block_10.out0)
getItemAtIndex_12 = List.GetItemAtIndex(list=sortByFunction@L2, index=code_block_10.out1)
getItemAtIndex_13 = List.GetItemAtIndex(list=sortByFunction@L2, index=code_block_10.out2)
getItemAtIndex_14 = List.GetItemAtIndex(list=sortByFunction@L2, index=code_block_10.out3)
getItemAtIndex_15 = List.GetItemAtIndex(list=sortByFunction@L2, index=code_block_10.out4)
getItemAtIndex_16 = List.GetItemAtIndex(list=sortByFunction@L2, index=code_block_10.out5)
combine_3 = List.Combine(create_3, getItemAtIndex_11, getItemAtIndex_12, getItemAtIndex_13, getItemAtIndex_14, getItemAtIndex_15, getItemAtIndex_16)
sortByKey = List.SortByKey(list=combine_3, keys=getItemAtIndex_16)
watch = Watch(sortByKey.sorted_list)

# group: Get Revisions and Current Revisions of Each Sheet
code_block_11 = CodeBlock { 0; }
getItemAtIndex_17 = List.GetItemAtIndex(list=watch@L2, index=code_block_11)
get_all_revisions = Custom[Get All Revisions](RunIt=getItemAtIndex_17)  # This node will return all Revisions currently defined in the mode.
addItemToEnd = List.AddItemToEnd()  # unwired: item, list
python_script = Python(IN[0]=get_all_revisions, IN[1]=getItemAtIndex_17)
# ---------- python_script.python (36 lines) ----------
import clr
# Import Element wrapper extension methods
clr.AddReference("RevitNodes")
import Revit
clr.ImportExtensions(Revit.Elements)

# Import DocumentManager and TransactionManager
clr.AddReference("RevitServices")
import RevitServices
from RevitServices.Persistence import DocumentManager
doc = DocumentManager.Instance.CurrentDBDocument

# Import RevitAPI
clr.AddReference("RevitAPI")
import Autodesk
from Autodesk.Revit.DB import *

import sys
pyt_path = r'C:\Program Files (x86)\IronPython 2.7\Lib'
sys.path.append(pyt_path)

revisions = UnwrapElement(IN[0])
sheets = UnwrapElement(IN[1])

revs = []
r = []
Output = []

for sheet, revision in zip(sheets, revisions):
    revnum = []
    for rev in revision:
        r = Autodesk.Revit.DB.ViewSheet.GetRevisionNumberOnSheet(sheet, rev.Id)        
        revnum.append(r)
    Output.append(revnum)
        
OUT = Output
# ----------------------------------------
removeNull = Custom[RemoveNull](list=python_script)  # Remove null from lists
lastItem = List.LastItem(removeNull@L2)

# group: Get Revision Dates Splited into Days, Months and Years
revision_properties = Custom[Revision Properties](Revision=get_all_revisions)  # This node will return some most common Revision properties like Description or Issue Date.
firstItem = List.FirstItem(revision_properties.Date)
sortIndexByValue = SortIndexByValue(revision_properties.Sequence)
firstItem_2 = List.FirstItem(sortIndexByValue)
getItemAtIndex_18 = List.GetItemAtIndex(list=firstItem, index=firstItem_2)
code_block_12 = CodeBlock { "/"; }
split_2 = String.Split(getItemAtIndex_18, code_block_12)

# group: First Excel Row with Project Name and Revision Days
string = StringInput("950498 Block 1 Charlemont St - Scheme 2")
code_block_13 = CodeBlock { {"","Day","",""}; }
join = List.Join(string, code_block_13)
code_block_14 = CodeBlock { 0; }
getItemAtIndex_19 = List.GetItemAtIndex(list=split_2@L2, index=code_block_14)
addItemToFront = List.AddItemToFront(item=join, list=getItemAtIndex_19)
flatten = Flatten(addItemToFront)

# group: Second Excel Row with Revision Months
code_block_15 = CodeBlock { {"","","Mounth","",""}; }
code_block_16 = CodeBlock { 1; }
getItemAtIndex_20 = List.GetItemAtIndex(list=split_2@L2, index=code_block_16)
addItemToFront_2 = List.AddItemToFront(item=code_block_15, list=getItemAtIndex_20)
flatten_2 = Flatten(addItemToFront_2)

# group: Third Excel Row with Revision Years
code_block_17 = CodeBlock { {"","","Year","",""}; }
code_block_18 = CodeBlock { 2; }
getItemAtIndex_21 = List.GetItemAtIndex(list=split_2@L2, index=code_block_18)
code_block_19 = CodeBlock { 0; 2; }
remove = String.Remove(str=getItemAtIndex_21, startIndex=code_block_19.out0, count=code_block_19.out1)
addItemToFront_3 = List.AddItemToFront(item=code_block_17, list=remove)
flatten_3 = Flatten(addItemToFront_3)

# group: Fourth Excel Row
code_block_20 = CodeBlock()
# ---------- code_block_20.designscript (2 lines) ----------
{"DRG. NO.","DRAWING TITLE","SCALE","SIZE","CURRENT
REVISION"};
# ----------------------------------------

# group: Final List of Drawing Series No./Sheet No./SheetName/Scale/Paper Size
addItemToFront_4 = List.AddItemToFront()  # unwired: item, list
code_block_21 = CodeBlock { 1; 2; 3; 4; 5; }
getItemAtIndex_22 = List.GetItemAtIndex(list=watch@L2, index=code_block_21.out0)
getItemAtIndex_23 = List.GetItemAtIndex(list=watch@L2, index=code_block_21.out4)
groupByKey = List.GroupByKey(list=getItemAtIndex_22, keys=getItemAtIndex_23)
combine_4 = List.Combine(addItemToFront_4, groupByKey.unique_keys, groupByKey.groups)
flatten_4 = Flatten(combine_4)
empty = List.Empty()
getItemAtIndex_24 = List.GetItemAtIndex(list=watch@L2, index=code_block_21.out1)
groupByKey_2 = List.GroupByKey(list=getItemAtIndex_24, keys=getItemAtIndex_23)
combine_5 = List.Combine(addItemToFront_4, empty, groupByKey_2.groups)
flatten_5 = Flatten(combine_5)
getItemAtIndex_25 = List.GetItemAtIndex(list=watch@L2, index=code_block_21.out2)
groupByKey_3 = List.GroupByKey(list=getItemAtIndex_25, keys=getItemAtIndex_23)
combine_6 = List.Combine(addItemToFront_4, empty, groupByKey_3.groups)
flatten_6 = Flatten(combine_6)
getItemAtIndex_26 = List.GetItemAtIndex(list=watch@L2, index=code_block_21.out3)
groupByKey_4 = List.GroupByKey(list=getItemAtIndex_26, keys=getItemAtIndex_23)
combine_7 = List.Combine(addItemToFront_4, empty, groupByKey_4.groups)
flatten_7 = Flatten(combine_7)
create_4 = List.Create(flatten_4, flatten_5, flatten_6, flatten_7)
transpose = List.Transpose(create_4)

# group (continued): Get Revisions and Current Revisions of Each Sheet
getItemAtIndex_27 = List.GetItemAtIndex(list=python_script@L2, index=sortIndexByValue@L2)
combine_8 = List.Combine(addItemToEnd, getItemAtIndex_27, lastItem)
flatten_8 = Flatten(combine_8@L3)

# group: Grouping by Drawing Series No.
code_block_22 = CodeBlock { "24_DrawingSeriesNo_HJL"; }
getParameterValueByName_5 = Element.GetParameterValueByName(element=getItemAtIndex_17, parameterName=code_block_22)
groupByKey_5 = List.GroupByKey(list=flatten_8, keys=getParameterValueByName_5)

# group: Adding " " Value in Each Drawings Series Row
code_block_23 = CodeBlock(a=groupByKey_5.groups) { a[0][0]; }
count = Count(code_block_23)
code_block_24 = CodeBlock(count=count) { 1..count..1; }
string_from_object_2 = FromObject(code_block_24)
code_block_25 = CodeBlock { " "; }
replace = String.Replace(str=string_from_object_2, searchFor=string_from_object_2, replaceWith=code_block_25)
count_2 = Count(groupByKey_5.unique_keys)
cycle = List.Cycle(list=replace, amount=count_2)
count_3 = Count(replace)
chop = List.Chop(list=cycle, lengths=count_3)

# group: Combime Drawings Series No. Rows and Revision Rows
addItemToFront_5 = List.AddItemToFront()  # unwired: item, list
combine_9 = List.Combine(addItemToFront_5, chop, groupByKey_5.groups)
flatten_9 = Flatten(combine_9@L2)
watch_2 = Watch(flatten_9)

# group: Combine Sheet Numeber/Name/Scale/Paper Size/Revisions
join_2 = List.Join()  # unwired: arg0, arg1
combine_10 = List.Combine(join_2, transpose, watch_2)
code_block_26 = CodeBlock { " "; }
isNull = Object.IsNull()  # unwired: arg0
replaceByCondition = Replace(combine_10, code_block_26, isNull)

# group: Putting Rows Together
addItemToFront_6 = List.AddItemToFront(item=code_block_20, list=replaceByCondition)
addItemToFront_7 = List.AddItemToFront(item=flatten_3, list=addItemToFront_6)
addItemToFront_8 = List.AddItemToFront(item=flatten_2, list=addItemToFront_7)
addItemToFront_9 = List.AddItemToFront(item=flatten, list=addItemToFront_8)

# group: Adding " " Values After the Last Revision
code_block_27 = CodeBlock { {"","","","",""}; }
addItemToEnd_2 = List.AddItemToEnd(item=code_block_27, list=addItemToFront_9@L2)
flatten_10 = Flatten(addItemToEnd_2@L3)

# group: Read Excel
boolean_2 = BoolSelector(true)
code_block_28 = CodeBlock { "Circulation"; }
boolean_3 = BoolSelector(false)
code_block_29 = CodeBlock { "A1"; }
read_excel = Custom[Read Excel](filePath=start, runIt=boolean_2, sheetName=code_block_28, byColumn=boolean_3, origin=code_block_29)  # This node will read an excel file. You can read an entore sheet contents, read from specific origin cell, read only specific range, or do all of the former for multiple sheets at the same time.

# group: Adding Blank Rows
lastItem_2 = List.LastItem(flatten_10)
count_4 = Count(lastItem_2)
code_block_30 = CodeBlock(count=count_4) { 1..count..1; }
string_from_object_3 = FromObject(code_block_30)
code_block_31 = CodeBlock { " "; }
replace_2 = String.Replace(str=string_from_object_3, searchFor=string_from_object_3, replaceWith=code_block_31)
create_5 = List.Create(replace_2, replace_2, replace_2)
join_3 = List.Join(create_5, read_excel, create_5)
watch_3 = Watch(join_3)

# group: Join Revit Info and Excel Info
join_4 = List.Join(flatten_10, watch_3)
watch_4 = Watch(join_4)

# group: Licence
now = DateTime.Now()
code_block_32 = CodeBlock { "dd/MM/yyyy"; }
format = DateTime.Format(now, code_block_32)
code_block_33 = CodeBlock { "08/09/2020"; }
eq_2 = format == code_block_33
code_block_34 = CodeBlock { "Renew Licence"; }
if_ = If(test=eq_2, true=code_block_34, false=watch_4)

# group: Write Excel
boolean_4 = BoolSelector(true)
string_2 = StringInput("Issue Sheet - Stage 1")
string_3 = StringInput("A5")
bb_data = Custom[BB Data](SheetName=string_2, Origin=string_3, Data=if_)  # This node is a building block for different modes of writing to Excel files. You can combines this node into a list to write to multiple sheets or use just one to write to a single sheet.
write_excel = Custom[Write Excel](filePath=file_path, RunIt=boolean_4, BBData=bb_data)  # This node will write data to Excel file and based on how your BBData nodes are structured it will either override the exsting file, create a new one and write a single worksheet or write multiple worksheets.
end = Revit.Transaction.Transaction.End(write_excel)

watch_5 = Watch(groupByKey.unique_keys)
