# Dynamo graph Issue Sheetv5.dyn (Dynamo 1.3.4.6666)

code_block = CodeBlock { "Revision No."; }
create = List.Create()  # unwired: arg0, arg1, arg2, arg3, arg4, arg5
code_block_2 = CodeBlock { 0; 1; 2; 3; 5; 4; }
getItemAtIndex = List.GetItemAtIndex(index=code_block_2.out0)  # unwired: list
getItemAtIndex_2 = List.GetItemAtIndex(index=code_block_2.out1)  # unwired: list
getItemAtIndex_3 = List.GetItemAtIndex(index=code_block_2.out2)  # unwired: list
getItemAtIndex_4 = List.GetItemAtIndex(index=code_block_2.out3)  # unwired: list
getItemAtIndex_5 = List.GetItemAtIndex(index=code_block_2.out4)  # unwired: list
getItemAtIndex_6 = List.GetItemAtIndex(index=code_block_2.out5)  # unwired: list
combine = List.Combine(create, getItemAtIndex, getItemAtIndex_2, getItemAtIndex_3, getItemAtIndex_4, getItemAtIndex_5, getItemAtIndex_6)
sortByKey = List.SortByKey(list=combine, keys=getItemAtIndex_6)
watch = Watch(sortByKey.sorted_list)
code_block_3 = CodeBlock { 0; 1; 2; 3; 4; 5; }
getItemAtIndex_7 = List.GetItemAtIndex(list=watch@L2, index=code_block_3.out0)
get_all_revisions = Custom[Get All Revisions](RunIt=getItemAtIndex_7)  # This node will return all Revisions currently defined in the mode.
revision_properties = Custom[Revision Properties](Revision=get_all_revisions)  # This node will return some most common Revision properties like Description or Issue Date.
sortIndexByValue = SortIndexByValue(revision_properties.Sequence)
firstItem = List.FirstItem(sortIndexByValue)
sort = List.Sort(firstItem)
count = List.Count(sort)
add = code_block + count
watch_2 = Watch(add)
create_2 = List.Create()  # unwired: arg0, arg1, arg2, arg3, arg4, arg5, arg6
create_3 = List.Create()  # unwired: arg0, arg1, arg2
categories = Categories("Sheets")
all_elements_of_category = ElementsOfCategory(categories)
code_block_4 = CodeBlock { "24_DrawingSeriesNo_HJL"; "Sheet Number"; }
getParameterValueByName = Element.GetParameterValueByName(element=all_elements_of_category, parameterName=code_block_4.out0)
categories_2 = Categories("TitleBlocks")
all_elements_of_category_2 = ElementsOfCategory(categories_2)
getParameterValueByName_2 = Element.GetParameterValueByName(element=all_elements_of_category, parameterName=code_block_4.out1)
getParameterValueByName_3 = Element.GetParameterValueByName(element=all_elements_of_category_2, parameterName=code_block_4.out1)
indexOf = IndexOf(getParameterValueByName_3)  # unwired: arg1
map = List.Map(list=getParameterValueByName_2, f_x=indexOf)
getItemAtIndex_8 = List.GetItemAtIndex(list=all_elements_of_category_2, index=map)
combine_2 = List.Combine(create_3, all_elements_of_category, getParameterValueByName, getItemAtIndex_8)
code_block_5 = CodeBlock { 0; 1; 2; }
getItemAtIndex_9 = List.GetItemAtIndex(list=combine_2@L2, index=code_block_5.out0)
sheetNumber = Sheet.SheetNumber(getItemAtIndex_9)
sheetName = Sheet.SheetName(getItemAtIndex_9)
scale = Custom[Sheet.Scale](sheet=getItemAtIndex_9)  # Returns the scale of a given sheet
getItemAtIndex_10 = List.GetItemAtIndex(list=combine_2@L2, index=code_block_5.out1)
getItemAtIndex_11 = List.GetItemAtIndex(list=combine_2@L2, index=code_block_5.out2)
string_from_object = FromObject(getItemAtIndex_11)
code_block_6 = CodeBlock { "_"; }
split = String.Split(string_from_object, code_block_6)
code_block_7 = CodeBlock { 3; 2; }
getItemAtIndex_12 = List.GetItemAtIndex(list=split@L2, index=code_block_7.out1)
code_block_8 = CodeBlock { 2; " "; }
insert = String.Insert(str=getItemAtIndex_12, index=code_block_8.out0, toInsert=code_block_8.out1)
getItemAtIndex_13 = List.GetItemAtIndex(list=split@L2, index=code_block_7.out0)
add_2 = insert + getItemAtIndex_13
code_block_9 = CodeBlock { "Appears In Sheet List"; }
getParameterValueByName_4 = Element.GetParameterValueByName(element=getItemAtIndex_9, parameterName=code_block_9)
watch_3 = Watch(getParameterValueByName_4)
combine_3 = List.Combine(create_2, getItemAtIndex_9, sheetNumber, sheetName, scale, getItemAtIndex_10, add_2, watch_3)
watch_4 = Watch(combine_3)
file_path = Filename("..\MIDP.xlsx")
boolean = BoolSelector(true)
code_block_10 = CodeBlock { "Drawing Register"; "A10"; }
now = DateTime.Now()
code_block_11 = CodeBlock { "dd/MM/yyyy"; }
format = DateTime.Format(now, code_block_11)
code_block_12 = CodeBlock { "08/09/2020"; }
eq = format == code_block_12
code_block_13 = CodeBlock { "Renew Licence"; }
code_block_14 = CodeBlock { {"","","",""}; }
firstItem_2 = List.FirstItem(revision_properties.Date)
getItemAtIndex_14 = List.GetItemAtIndex(list=firstItem_2, index=firstItem)
addItemToFront = List.AddItemToFront(item=code_block_14, list=getItemAtIndex_14)
flatten = Flatten(addItemToFront)
watch_5 = Watch(flatten)
join = List.Join()  # unwired: arg0, arg1
addItemToFront_2 = List.AddItemToFront()  # unwired: item, list
getItemAtIndex_15 = List.GetItemAtIndex(list=watch@L2, index=code_block_3.out1)
getItemAtIndex_16 = List.GetItemAtIndex(list=watch@L2, index=code_block_3.out5)
groupByKey = List.GroupByKey(list=getItemAtIndex_15, keys=getItemAtIndex_16)
combine_4 = List.Combine(addItemToFront_2, groupByKey.unique_keys, groupByKey.groups)
flatten_2 = Flatten(combine_4)
empty = List.Empty()
getItemAtIndex_17 = List.GetItemAtIndex(list=watch@L2, index=code_block_3.out2)
groupByKey_2 = List.GroupByKey(list=getItemAtIndex_17, keys=getItemAtIndex_16)
combine_5 = List.Combine(addItemToFront_2, empty, groupByKey_2.groups)
flatten_3 = Flatten(combine_5)
getItemAtIndex_18 = List.GetItemAtIndex(list=watch@L2, index=code_block_3.out3)
groupByKey_3 = List.GroupByKey(list=getItemAtIndex_18, keys=getItemAtIndex_16)
combine_6 = List.Combine(addItemToFront_2, empty, groupByKey_3.groups)
flatten_4 = Flatten(combine_6)
getItemAtIndex_19 = List.GetItemAtIndex(list=watch@L2, index=code_block_3.out4)
groupByKey_4 = List.GroupByKey(list=getItemAtIndex_19, keys=getItemAtIndex_16)
combine_7 = List.Combine(addItemToFront_2, empty, groupByKey_4.groups)
flatten_5 = Flatten(combine_7)
create_4 = List.Create(flatten_2, flatten_3, flatten_4, flatten_5)
transpose = List.Transpose(create_4)
addItemToFront_3 = List.AddItemToFront()  # unwired: item, list
empty_2 = List.Empty()
python_script = Python(IN[0]=get_all_revisions, IN[1]=getItemAtIndex_7)
# ---------- python_script.python (36 lines) ----------
import clr
# Import Element wrapper extension methods
clr.AddReference("RevitNodes")
import Revit
clr.ImportExtensions(Revit.Elements)

# Import DocumentManager and TransactionManager
clr.AddReference("RevitServices")
import RevitServices
from RevitServices.Persistence import DocumentManager
doc = DocumentManager.Instance.CurrentDBDocument

# Import RevitAPI
clr.AddReference("RevitAPI")
import Autodesk
from Autodesk.Revit.DB import *

import sys
pyt_path = r'C:\Program Files (x86)\IronPython 2.7\Lib'
sys.path.append(pyt_path)

revisions = UnwrapElement(IN[0])
sheets = UnwrapElement(IN[1])

revs = []
r = []
Output = []

for sheet, revision in zip(sheets, revisions):
    revnum = []
    for rev in revision:
        r = Autodesk.Revit.DB.ViewSheet.GetRevisionNumberOnSheet(sheet, rev.Id)        
        revnum.append(r)
    Output.append(revnum)
        
OUT = Output
# ----------------------------------------
getItemAtIndex_20 = List.GetItemAtIndex(list=python_script@L2, index=sortIndexByValue@L2)
code_block_15 = CodeBlock { "24_DrawingSeriesNo_HJL"; }
getParameterValueByName_5 = Element.GetParameterValueByName(element=getItemAtIndex_7, parameterName=code_block_15)
groupByKey_5 = List.GroupByKey(list=getItemAtIndex_20, keys=getParameterValueByName_5)
combine_8 = List.Combine(addItemToFront_3, empty_2, groupByKey_5.groups)
flatten_6 = Flatten(combine_8)
count_2 = Count(combine_8@L2)
chop = List.Chop(list=flatten_6, lengths=count_2)
watch_6 = Watch(chop)
combine_9 = List.Combine(join, transpose, watch_6)
code_block_16 = CodeBlock { " "; }
isNull = Object.IsNull()  # unwired: arg0
replaceByCondition = Replace(combine_9, code_block_16, isNull)
addItemToFront_4 = List.AddItemToFront(item=watch_5, list=replaceByCondition)
watch_7 = Watch(addItemToFront_4)
if_ = If(test=eq, true=code_block_13, false=watch_7)
bb_data = Custom[BB Data](SheetName=code_block_10.out0, Origin=code_block_10.out1, Data=if_)  # This node is a building block for different modes of writing to Excel files. You can combines this node into a list to write to multiple sheets or use just one to write to a single sheet.
write_excel = Custom[Write Excel](filePath=file_path, RunIt=boolean, BBData=bb_data)  # This node will write data to Excel file and based on how your BBData nodes are structured it will either override the exsting file, create a new one and write a single worksheet or write multiple worksheets.
watch_8 = Watch(add_2)
watch_9 = Watch(if_)
code_block_17 = CodeBlock { 6; }
getItemAtIndex_21 = List.GetItemAtIndex(index=code_block_17)  # unwired: list
sortByFunction = SortByFunction(combine_3, getItemAtIndex_21)
watch_10 = Watch(sortByFunction)
