# Dynamo graph Issue Sheetv7.dyn (Dynamo 1.3.4.6666)

code_block = CodeBlock { "Revision No."; }
create = List.Create()  # unwired: arg0, arg1, arg2, arg3, arg4, arg5
create_2 = List.Create()  # unwired: arg0, arg1, arg2, arg3, arg4, arg5
create_3 = List.Create()  # unwired: arg0, arg1, arg2
categories = Categories("Sheets")
all_elements_of_category = ElementsOfCategory(categories)
code_block_2 = CodeBlock { "Appears In Sheet List"; }
getParameterValueByName = Element.GetParameterValueByName(element=all_elements_of_category, parameterName=code_block_2)
code_block_3 = CodeBlock { 1; }
eq = getParameterValueByName == code_block_3
boolean = BoolSelector(true)
allIndicesOf = List.AllIndicesOf(list=eq, item=boolean)
getItemAtIndex = List.GetItemAtIndex(list=all_elements_of_category, index=allIndicesOf)
code_block_4 = CodeBlock { "24_DrawingSeriesNo_HJL"; "Sheet Number"; }
getParameterValueByName_2 = Element.GetParameterValueByName(element=all_elements_of_category, parameterName=code_block_4.out0)
getItemAtIndex_2 = List.GetItemAtIndex(list=getParameterValueByName_2, index=allIndicesOf)
categories_2 = Categories("TitleBlocks")
all_elements_of_category_2 = ElementsOfCategory(categories_2)
getParameterValueByName_3 = Element.GetParameterValueByName(element=all_elements_of_category, parameterName=code_block_4.out1)
getParameterValueByName_4 = Element.GetParameterValueByName(element=all_elements_of_category_2, parameterName=code_block_4.out1)
indexOf = IndexOf(getParameterValueByName_4)  # unwired: arg1
map = List.Map(list=getParameterValueByName_3, f_x=indexOf)
getItemAtIndex_3 = List.GetItemAtIndex(list=all_elements_of_category_2, index=map)
getItemAtIndex_4 = List.GetItemAtIndex(list=getItemAtIndex_3, index=allIndicesOf)
combine = List.Combine(create_3, getItemAtIndex, getItemAtIndex_2, getItemAtIndex_4)
code_block_5 = CodeBlock { 0; 1; 2; }
getItemAtIndex_5 = List.GetItemAtIndex(list=combine@L2, index=code_block_5.out0)
sheetNumber = Sheet.SheetNumber(getItemAtIndex_5)
sheetName = Sheet.SheetName(getItemAtIndex_5)
scale = Custom[Sheet.Scale](sheet=getItemAtIndex_5)  # Returns the scale of a given sheet
getItemAtIndex_6 = List.GetItemAtIndex(list=combine@L2, index=code_block_5.out1)
getItemAtIndex_7 = List.GetItemAtIndex(list=combine@L2, index=code_block_5.out2)
string_from_object = FromObject(getItemAtIndex_7)
code_block_6 = CodeBlock { "_"; }
split = String.Split(string_from_object, code_block_6)
code_block_7 = CodeBlock { 3; 2; }
getItemAtIndex_8 = List.GetItemAtIndex(list=split@L2, index=code_block_7.out1)
code_block_8 = CodeBlock { 2; " "; }
insert = String.Insert(str=getItemAtIndex_8, index=code_block_8.out0, toInsert=code_block_8.out1)
getItemAtIndex_9 = List.GetItemAtIndex(list=split@L2, index=code_block_7.out0)
add = insert + getItemAtIndex_9
combine_2 = List.Combine(create_2, getItemAtIndex_5, sheetNumber, sheetName, scale, getItemAtIndex_6, add)
code_block_9 = CodeBlock { 1; }
getItemAtIndex_10 = List.GetItemAtIndex(index=code_block_9)  # unwired: list
sortByFunction = SortByFunction(combine_2, getItemAtIndex_10)
code_block_10 = CodeBlock { 0; 1; 2; 3; 5; 4; }
getItemAtIndex_11 = List.GetItemAtIndex(list=sortByFunction@L2, index=code_block_10.out0)
getItemAtIndex_12 = List.GetItemAtIndex(list=sortByFunction@L2, index=code_block_10.out1)
getItemAtIndex_13 = List.GetItemAtIndex(list=sortByFunction@L2, index=code_block_10.out2)
getItemAtIndex_14 = List.GetItemAtIndex(list=sortByFunction@L2, index=code_block_10.out3)
getItemAtIndex_15 = List.GetItemAtIndex(list=sortByFunction@L2, index=code_block_10.out4)
getItemAtIndex_16 = List.GetItemAtIndex(list=sortByFunction@L2, index=code_block_10.out5)
combine_3 = List.Combine(create, getItemAtIndex_11, getItemAtIndex_12, getItemAtIndex_13, getItemAtIndex_14, getItemAtIndex_15, getItemAtIndex_16)
sortByKey = List.SortByKey(list=combine_3, keys=getItemAtIndex_16)
watch = Watch(sortByKey.sorted_list)
code_block_11 = CodeBlock { 0; 1; 2; 3; 4; 5; }
getItemAtIndex_17 = List.GetItemAtIndex(list=watch@L2, index=code_block_11.out0)
get_all_revisions = Custom[Get All Revisions](RunIt=getItemAtIndex_17)  # This node will return all Revisions currently defined in the mode.
revision_properties = Custom[Revision Properties](Revision=get_all_revisions)  # This node will return some most common Revision properties like Description or Issue Date.
sortIndexByValue = SortIndexByValue(revision_properties.Sequence)
firstItem = List.FirstItem(sortIndexByValue)
sort = List.Sort(firstItem)
count = List.Count(sort)
add_2 = code_block + count
watch_2 = Watch(add_2)
watch_3 = Watch(combine_2)
file_path = Filename("..\MIDP.xlsx")
boolean_2 = BoolSelector(true)
code_block_12 = CodeBlock { "Drawing Register"; "A10"; }
now = DateTime.Now()
code_block_13 = CodeBlock { "dd/MM/yyyy"; }
format = DateTime.Format(now, code_block_13)
code_block_14 = CodeBlock { "08/09/2020"; }
eq_2 = format == code_block_14
code_block_15 = CodeBlock { "Renew Licence"; }
code_block_16 = CodeBlock { {"","","",""}; }
firstItem_2 = List.FirstItem(revision_properties.Date)
getItemAtIndex_18 = List.GetItemAtIndex(list=firstItem_2, index=firstItem)
code_block_17 = CodeBlock { "/"; }
split_2 = String.Split(getItemAtIndex_18, code_block_17)
code_block_18 = CodeBlock { 0; 1; 2; }
getItemAtIndex_19 = List.GetItemAtIndex(list=split_2@L2, index=code_block_18.out0)
addItemToFront = List.AddItemToFront(item=code_block_16, list=getItemAtIndex_19)
flatten = Flatten(addItemToFront)
getItemAtIndex_20 = List.GetItemAtIndex(list=split_2@L2, index=code_block_18.out1)
addItemToFront_2 = List.AddItemToFront(item=code_block_16, list=getItemAtIndex_20)
flatten_2 = Flatten(addItemToFront_2)
getItemAtIndex_21 = List.GetItemAtIndex(list=split_2@L2, index=code_block_18.out2)
code_block_19 = CodeBlock { 0; 2; }
remove = String.Remove(str=getItemAtIndex_21, startIndex=code_block_19.out0, count=code_block_19.out1)
addItemToFront_3 = List.AddItemToFront(item=code_block_16, list=remove)
flatten_3 = Flatten(addItemToFront_3)
join = List.Join()  # unwired: arg0, arg1
addItemToFront_4 = List.AddItemToFront()  # unwired: item, list
getItemAtIndex_22 = List.GetItemAtIndex(list=watch@L2, index=code_block_11.out1)
getItemAtIndex_23 = List.GetItemAtIndex(list=watch@L2, index=code_block_11.out5)
groupByKey = List.GroupByKey(list=getItemAtIndex_22, keys=getItemAtIndex_23)
combine_4 = List.Combine(addItemToFront_4, groupByKey.unique_keys, groupByKey.groups)
flatten_4 = Flatten(combine_4)
empty = List.Empty()
getItemAtIndex_24 = List.GetItemAtIndex(list=watch@L2, index=code_block_11.out2)
groupByKey_2 = List.GroupByKey(list=getItemAtIndex_24, keys=getItemAtIndex_23)
combine_5 = List.Combine(addItemToFront_4, empty, groupByKey_2.groups)
flatten_5 = Flatten(combine_5)
getItemAtIndex_25 = List.GetItemAtIndex(list=watch@L2, index=code_block_11.out3)
groupByKey_3 = List.GroupByKey(list=getItemAtIndex_25, keys=getItemAtIndex_23)
combine_6 = List.Combine(addItemToFront_4, empty, groupByKey_3.groups)
flatten_6 = Flatten(combine_6)
getItemAtIndex_26 = List.GetItemAtIndex(list=watch@L2, index=code_block_11.out4)
groupByKey_4 = List.GroupByKey(list=getItemAtIndex_26, keys=getItemAtIndex_23)
combine_7 = List.Combine(addItemToFront_4, empty, groupByKey_4.groups)
flatten_7 = Flatten(combine_7)
create_4 = List.Create(flatten_4, flatten_5, flatten_6, flatten_7)
transpose = List.Transpose(create_4)
addItemToFront_5 = List.AddItemToFront()  # unwired: item, list
python_script = Python(IN[0]=get_all_revisions, IN[1]=getItemAtIndex_17)
# ---------- python_script.python (36 lines) ----------
import clr
# Import Element wrapper extension methods
clr.AddReference("RevitNodes")
import Revit
clr.ImportExtensions(Revit.Elements)

# Import DocumentManager and TransactionManager
clr.AddReference("RevitServices")
import RevitServices
from RevitServices.Persistence import DocumentManager
doc = DocumentManager.Instance.CurrentDBDocument

# Import RevitAPI
clr.AddReference("RevitAPI")
import Autodesk
from Autodesk.Revit.DB import *

import sys
pyt_path = r'C:\Program Files (x86)\IronPython 2.7\Lib'
sys.path.append(pyt_path)

revisions = UnwrapElement(IN[0])
sheets = UnwrapElement(IN[1])

revs = []
r = []
Output = []

for sheet, revision in zip(sheets, revisions):
    revnum = []
    for rev in revision:
        r = Autodesk.Revit.DB.ViewSheet.GetRevisionNumberOnSheet(sheet, rev.Id)        
        revnum.append(r)
    Output.append(revnum)
        
OUT = Output
# ----------------------------------------
getItemAtIndex_27 = List.GetItemAtIndex(list=python_script@L2, index=sortIndexByValue@L2)
code_block_20 = CodeBlock { "24_DrawingSeriesNo_HJL"; }
getParameterValueByName_5 = Element.GetParameterValueByName(element=getItemAtIndex_17, parameterName=code_block_20)
groupByKey_5 = List.GroupByKey(list=getItemAtIndex_27, keys=getParameterValueByName_5)
code_block_21 = CodeBlock(a=groupByKey_5.groups) { a[0][0]; }
count_2 = Count(code_block_21)
code_block_22 = CodeBlock(count=count_2) { 1..count..1; }
string_from_object_2 = FromObject(code_block_22)
code_block_23 = CodeBlock { " "; }
replace = String.Replace(str=string_from_object_2, searchFor=string_from_object_2, replaceWith=code_block_23)
count_3 = Count(groupByKey_5.unique_keys)
cycle = List.Cycle(list=replace, amount=count_3)
count_4 = Count(replace)
chop = List.Chop(list=cycle, lengths=count_4)
combine_8 = List.Combine(addItemToFront_5, chop, groupByKey_5.groups)
flatten_8 = Flatten(combine_8@L2)
watch_4 = Watch(flatten_8)
combine_9 = List.Combine(join, transpose, watch_4)
code_block_24 = CodeBlock { " "; }
isNull = Object.IsNull()  # unwired: arg0
replaceByCondition = Replace(combine_9, code_block_24, isNull)
addItemToFront_6 = List.AddItemToFront(item=flatten_3, list=replaceByCondition)
addItemToFront_7 = List.AddItemToFront(item=flatten_2, list=addItemToFront_6)
addItemToFront_8 = List.AddItemToFront(item=flatten, list=addItemToFront_7)
watch_5 = Watch(addItemToFront_8)
if_ = If(test=eq_2, true=code_block_15, false=watch_5)  # frozen
bb_data = Custom[BB Data](SheetName=code_block_12.out0, Origin=code_block_12.out1, Data=if_)  # This node is a building block for different modes of writing to Excel files. You can combines this node into a list to write to multiple sheets or use just one to write to a single sheet.
write_excel = Custom[Write Excel](filePath=file_path, RunIt=boolean_2, BBData=bb_data)  # This node will write data to Excel file and based on how your BBData nodes are structured it will either override the exsting file, create a new one and write a single worksheet or write multiple worksheets.
watch_6 = Watch(add)
watch_7 = Watch(if_)
watch_8 = Watch(combine)
watch_9 = Watch(transpose)
