# Dynamo graph MIDPv9.dyn (Dynamo 1.3.4.6666)

create = List.Create()  # unwired: arg0, arg1, arg2, arg3, arg4, arg5
create_2 = List.Create()  # unwired: arg0, arg1, arg2
categories = Categories("Sheets")
all_elements_of_category = ElementsOfCategory(categories)
code_block = CodeBlock { "Appears In Sheet List"; }
getParameterValueByName = Element.GetParameterValueByName(element=all_elements_of_category, parameterName=code_block)
code_block_2 = CodeBlock { 1; }
eq = getParameterValueByName == code_block_2
boolean = BoolSelector(true)
allIndicesOf = List.AllIndicesOf(list=eq, item=boolean)
getItemAtIndex = List.GetItemAtIndex(list=all_elements_of_category, index=allIndicesOf)
code_block_3 = CodeBlock { "24_DrawingSeriesNo_HJL"; "Sheet Number"; }
getParameterValueByName_2 = Element.GetParameterValueByName(element=all_elements_of_category, parameterName=code_block_3.out0)
getItemAtIndex_2 = List.GetItemAtIndex(list=getParameterValueByName_2, index=allIndicesOf)
categories_2 = Categories("TitleBlocks")
all_elements_of_category_2 = ElementsOfCategory(categories_2)
getParameterValueByName_3 = Element.GetParameterValueByName(element=all_elements_of_category, parameterName=code_block_3.out1)
getParameterValueByName_4 = Element.GetParameterValueByName(element=all_elements_of_category_2, parameterName=code_block_3.out1)
indexOf = IndexOf(getParameterValueByName_4)  # unwired: arg1
map = List.Map(list=getParameterValueByName_3, f_x=indexOf)
getItemAtIndex_3 = List.GetItemAtIndex(list=all_elements_of_category_2, index=map)
getItemAtIndex_4 = List.GetItemAtIndex(list=getItemAtIndex_3, index=allIndicesOf)
combine = List.Combine(create_2, getItemAtIndex, getItemAtIndex_2, getItemAtIndex_4)
code_block_4 = CodeBlock { 0; 1; 2; }
getItemAtIndex_5 = List.GetItemAtIndex(list=combine@L2, index=code_block_4.out0)
sheetNumber = Sheet.SheetNumber(getItemAtIndex_5)
sheetName = Sheet.SheetName(getItemAtIndex_5)
scale = Custom[Sheet.Scale](sheet=getItemAtIndex_5)  # Returns the scale of a given sheet
getItemAtIndex_6 = List.GetItemAtIndex(list=combine@L2, index=code_block_4.out1)
getItemAtIndex_7 = List.GetItemAtIndex(list=combine@L2, index=code_block_4.out2)
string_from_object = FromObject(getItemAtIndex_7)
code_block_5 = CodeBlock { "_"; }
split = String.Split(string_from_object, code_block_5)
code_block_6 = CodeBlock { 3; 2; }
getItemAtIndex_8 = List.GetItemAtIndex(list=split@L2, index=code_block_6.out1)
code_block_7 = CodeBlock { 2; " "; }
insert = String.Insert(str=getItemAtIndex_8, index=code_block_7.out0, toInsert=code_block_7.out1)
getItemAtIndex_9 = List.GetItemAtIndex(list=split@L2, index=code_block_6.out0)
add = insert + getItemAtIndex_9
combine_2 = List.Combine(create, getItemAtIndex_5, sheetNumber, sheetName, scale, getItemAtIndex_6, add)
watch = Watch(combine_2)
watch_2 = Watch(add)
watch_3 = Watch(combine)
addItemToFront = List.AddItemToFront()  # unwired: item, list
create_3 = List.Create()  # unwired: arg0, arg1, arg2, arg3, arg4, arg5
code_block_8 = CodeBlock { 1; }
getItemAtIndex_10 = List.GetItemAtIndex(index=code_block_8)  # unwired: list
sortByFunction = SortByFunction(combine_2, getItemAtIndex_10)
code_block_9 = CodeBlock { 0; 1; 2; 3; 5; 4; }
getItemAtIndex_11 = List.GetItemAtIndex(list=sortByFunction@L2, index=code_block_9.out0)
getItemAtIndex_12 = List.GetItemAtIndex(list=sortByFunction@L2, index=code_block_9.out1)
getItemAtIndex_13 = List.GetItemAtIndex(list=sortByFunction@L2, index=code_block_9.out2)
getItemAtIndex_14 = List.GetItemAtIndex(list=sortByFunction@L2, index=code_block_9.out3)
getItemAtIndex_15 = List.GetItemAtIndex(list=sortByFunction@L2, index=code_block_9.out4)
getItemAtIndex_16 = List.GetItemAtIndex(list=sortByFunction@L2, index=code_block_9.out5)
combine_3 = List.Combine(create_3, getItemAtIndex_11, getItemAtIndex_12, getItemAtIndex_13, getItemAtIndex_14, getItemAtIndex_15, getItemAtIndex_16)
sortByKey = List.SortByKey(list=combine_3, keys=getItemAtIndex_16)
watch_4 = Watch(sortByKey.sorted_list)
code_block_10 = CodeBlock { 0; 1; 2; 3; 4; 5; }
getItemAtIndex_17 = List.GetItemAtIndex(list=watch_4@L2, index=code_block_10.out1)
getItemAtIndex_18 = List.GetItemAtIndex(list=watch_4@L2, index=code_block_10.out5)
groupByKey = List.GroupByKey(list=getItemAtIndex_17, keys=getItemAtIndex_18)
combine_4 = List.Combine(addItemToFront, groupByKey.unique_keys, groupByKey.groups)
flatten = Flatten(combine_4)
empty = List.Empty()
getItemAtIndex_19 = List.GetItemAtIndex(list=watch_4@L2, index=code_block_10.out2)
groupByKey_2 = List.GroupByKey(list=getItemAtIndex_19, keys=getItemAtIndex_18)
combine_5 = List.Combine(addItemToFront, empty, groupByKey_2.groups)
flatten_2 = Flatten(combine_5)
getItemAtIndex_20 = List.GetItemAtIndex(list=watch_4@L2, index=code_block_10.out3)
groupByKey_3 = List.GroupByKey(list=getItemAtIndex_20, keys=getItemAtIndex_18)
combine_6 = List.Combine(addItemToFront, empty, groupByKey_3.groups)
flatten_3 = Flatten(combine_6)
getItemAtIndex_21 = List.GetItemAtIndex(list=watch_4@L2, index=code_block_10.out4)
groupByKey_4 = List.GroupByKey(list=getItemAtIndex_21, keys=getItemAtIndex_18)
combine_7 = List.Combine(addItemToFront, empty, groupByKey_4.groups)
flatten_4 = Flatten(combine_7)
create_4 = List.Create(flatten, flatten_2, flatten_3, flatten_4)
transpose = List.Transpose(create_4)
watch_5 = Watch(transpose)
watch_6 = Watch(combine_5)
file_path = Filename("..\DR.xlsx")
boolean_2 = BoolSelector(true)
string = StringInput("Issue Sheet - Stage 1")
string_2 = StringInput("A5")
now = DateTime.Now()
code_block_11 = CodeBlock { "dd/MM/yyyy"; }
format = DateTime.Format(now, code_block_11)
code_block_12 = CodeBlock { "08/09/2020"; }
eq_2 = format == code_block_12
code_block_13 = CodeBlock { "Renew Licence"; }
code_block_14 = CodeBlock { {"","","","",""}; }
string_3 = StringInput("""30 - 32 Sir John Rogersons Quay
Whole Site - New Office Development""")
code_block_15 = CodeBlock { {"","Day","",""}; }
join = List.Join(string_3, code_block_15)
getItemAtIndex_22 = List.GetItemAtIndex(list=watch_4@L2, index=code_block_10.out0)
get_all_revisions = Custom[Get All Revisions](RunIt=getItemAtIndex_22)  # This node will return all Revisions currently defined in the mode.
revision_properties = Custom[Revision Properties](Revision=get_all_revisions)  # This node will return some most common Revision properties like Description or Issue Date.
firstItem = List.FirstItem(revision_properties.Date)
sortIndexByValue = SortIndexByValue(revision_properties.Sequence)
firstItem_2 = List.FirstItem(sortIndexByValue)
getItemAtIndex_23 = List.GetItemAtIndex(list=firstItem, index=firstItem_2)
code_block_16 = CodeBlock { "/"; }
split_2 = String.Split(getItemAtIndex_23, code_block_16)
code_block_17 = CodeBlock { 0; 1; 2; }
getItemAtIndex_24 = List.GetItemAtIndex(list=split_2@L2, index=code_block_17.out0)
addItemToFront_2 = List.AddItemToFront(item=join, list=getItemAtIndex_24)
flatten_5 = Flatten(addItemToFront_2)
code_block_18 = CodeBlock { {"","","Mounth","",""}; }
getItemAtIndex_25 = List.GetItemAtIndex(list=split_2@L2, index=code_block_17.out1)
addItemToFront_3 = List.AddItemToFront(item=code_block_18, list=getItemAtIndex_25)
flatten_6 = Flatten(addItemToFront_3)
code_block_19 = CodeBlock { {"","","Year","",""}; }
getItemAtIndex_26 = List.GetItemAtIndex(list=split_2@L2, index=code_block_17.out2)
code_block_20 = CodeBlock { 0; 2; }
remove = String.Remove(str=getItemAtIndex_26, startIndex=code_block_20.out0, count=code_block_20.out1)
addItemToFront_4 = List.AddItemToFront(item=code_block_19, list=remove)
flatten_7 = Flatten(addItemToFront_4)
code_block_21 = CodeBlock()
# ---------- code_block_21.designscript (2 lines) ----------
{"DRG. NO.","DRAWING TITLE","SCALE","SIZE","CURRENT
REVISION"};
# ----------------------------------------
join_2 = List.Join()  # unwired: arg0, arg1
addItemToFront_5 = List.AddItemToFront()  # unwired: item, list
addItemToEnd = List.AddItemToEnd()  # unwired: item, list
python_script = Python(IN[0]=get_all_revisions, IN[1]=getItemAtIndex_22)
# ---------- python_script.python (36 lines) ----------
import clr
# Import Element wrapper extension methods
clr.AddReference("RevitNodes")
import Revit
clr.ImportExtensions(Revit.Elements)

# Import DocumentManager and TransactionManager
clr.AddReference("RevitServices")
import RevitServices
from RevitServices.Persistence import DocumentManager
doc = DocumentManager.Instance.CurrentDBDocument

# Import RevitAPI
clr.AddReference("RevitAPI")
import Autodesk
from Autodesk.Revit.DB import *

import sys
pyt_path = r'C:\Program Files (x86)\IronPython 2.7\Lib'
sys.path.append(pyt_path)

revisions = UnwrapElement(IN[0])
sheets = UnwrapElement(IN[1])

revs = []
r = []
Output = []

for sheet, revision in zip(sheets, revisions):
    revnum = []
    for rev in revision:
        r = Autodesk.Revit.DB.ViewSheet.GetRevisionNumberOnSheet(sheet, rev.Id)        
        revnum.append(r)
    Output.append(revnum)
        
OUT = Output
# ----------------------------------------
getItemAtIndex_27 = List.GetItemAtIndex(list=python_script@L2, index=sortIndexByValue@L2)
revisions = Archilab.Grimshaw.Views.Sheet.Revisions(getItemAtIndex_22)
count = Count(revisions@L2)
combine_8 = List.Combine(addItemToEnd, getItemAtIndex_27, count)
flatten_8 = Flatten(combine_8@L3)
code_block_22 = CodeBlock { "24_DrawingSeriesNo_HJL"; }
getParameterValueByName_5 = Element.GetParameterValueByName(element=getItemAtIndex_22, parameterName=code_block_22)
groupByKey_5 = List.GroupByKey(list=flatten_8, keys=getParameterValueByName_5)
code_block_23 = CodeBlock(a=groupByKey_5.groups) { a[0][0]; }
count_2 = Count(code_block_23)
code_block_24 = CodeBlock(count=count_2) { 1..count..1; }
string_from_object_2 = FromObject(code_block_24)
code_block_25 = CodeBlock { " "; }
replace = String.Replace(str=string_from_object_2, searchFor=string_from_object_2, replaceWith=code_block_25)
count_3 = Count(groupByKey_5.unique_keys)
cycle = List.Cycle(list=replace, amount=count_3)
count_4 = Count(replace)
chop = List.Chop(list=cycle, lengths=count_4)
combine_9 = List.Combine(addItemToFront_5, chop, groupByKey_5.groups)
flatten_9 = Flatten(combine_9@L2)
watch_7 = Watch(flatten_9)
combine_10 = List.Combine(join_2, transpose, watch_7)
code_block_26 = CodeBlock { " "; }
isNull = Object.IsNull()  # unwired: arg0
replaceByCondition = Replace(combine_10, code_block_26, isNull)
addItemToFront_6 = List.AddItemToFront(item=code_block_21, list=replaceByCondition)
addItemToFront_7 = List.AddItemToFront(item=flatten_7, list=addItemToFront_6)
addItemToFront_8 = List.AddItemToFront(item=flatten_6, list=addItemToFront_7)
addItemToFront_9 = List.AddItemToFront(item=flatten_5, list=addItemToFront_8)
addItemToEnd_2 = List.AddItemToEnd(item=code_block_14, list=addItemToFront_9@L2)
flatten_10 = Flatten(addItemToEnd_2@L3)
lastItem = List.LastItem(flatten_10)
count_5 = Count(lastItem)
code_block_27 = CodeBlock(count=count_5) { 1..count..1; }
string_from_object_3 = FromObject(code_block_27)
code_block_28 = CodeBlock { " "; }
replace_2 = String.Replace(str=string_from_object_3, searchFor=string_from_object_3, replaceWith=code_block_28)
create_5 = List.Create(replace_2, replace_2, replace_2)
start = Revit.Transaction.Transaction.Start(file_path)
boolean_3 = BoolSelector(true)
code_block_29 = CodeBlock { "Circulation"; }
boolean_4 = BoolSelector(false)
code_block_30 = CodeBlock { "A1"; }
read_excel = Custom[Read Excel](filePath=start, runIt=boolean_3, sheetName=code_block_29, byColumn=boolean_4, origin=code_block_30)  # This node will read an excel file. You can read an entore sheet contents, read from specific origin cell, read only specific range, or do all of the former for multiple sheets at the same time.
join_3 = List.Join(create_5, read_excel, create_5)
watch_8 = Watch(join_3)
join_4 = List.Join(flatten_10, watch_8)
watch_9 = Watch(join_4)
if_ = If(test=eq_2, true=code_block_13, false=watch_9)
bb_data = Custom[BB Data](SheetName=string, Origin=string_2, Data=if_)  # This node is a building block for different modes of writing to Excel files. You can combines this node into a list to write to multiple sheets or use just one to write to a single sheet.
write_excel = Custom[Write Excel](filePath=file_path, RunIt=boolean_2, BBData=bb_data)  # This node will write data to Excel file and based on how your BBData nodes are structured it will either override the exsting file, create a new one and write a single worksheet or write multiple worksheets.
end = Revit.Transaction.Transaction.End(write_excel)
